# Grasshopper definition tshirt.gh (Grasshopper 1.0.8)
# plug-ins: RhinoCodePluginGH, MeshEdit Components

mesh = Mesh(<mesh referenced from the Rhino model>)  # disabled
demesh = DeconstructMesh(Mesh=mesh)  # -> Vertices, Faces, Colours, Normals
pdecon = Deconstruct(Point=demesh.Vertices)  # -> XComponent, YComponent, ZComponent
bnd = Bounds(Numbers=pdecon.ZComponent)
dedomain = DeconstructDomain(Domain=bnd)  # -> Start, End
gradient = Gradient(
    LowerLimit=dedomain.Start,
    UpperLimit=dedomain.End,
    Parameter=pdecon.ZComponent,
    stops=[0.15: RGB(255, 130, 160), 0.85: RGB(220, 0, 40)])
mcol = MeshColours(Mesh=mesh, Colours=gradient)

mesh_2 = Mesh(<mesh referenced from the Rhino model>)  # disabled
wheel = ColourWheel(
    Slider(1, range=0..10),
    ColourGrips_Style=31,
    ColourGrips_Grip=[4.765872043, 0.5770818378, 2.67147694, 1.624279389],
    ColourGrips_Lum=[0.4292022982, 0.1858593574],
    ColourGrips_Range=[2.586695162, 2.586695162, 2.586695162, 2.586695162],
    ColourGrips_Sat=[0.4866029746, 0.6967433237])
mcol_2 = MeshColours(Mesh=mesh_2, Colours=wheel)

mesh_3 = Mesh(<mesh referenced from the Rhino model>)
py3 = Python3Script()  # -> out, a
# ---------- py3: Python ----------
import random

def random_numbers():
    numbers = random.sample(range(10), random.randint(1, 10))
    return numbers

a = random_numbers()
print(a)
# ---------- end py3 ----------
py3_2 = Python3Script()  # -> out, c
# ---------- py3_2: Python ----------
# requirements: numpy
# requirements: opencv-python
# requirements: scipy
# requirements: pandas
import sys
import os
sys.path.append('/Users/martinsssssss/Desktop/6th Semester/Social Innovation/gh/')  # Add the directory containing your script to the Python path
import prueba  # Import your external Python script

directory = "/Users/martinsssssss/Desktop/6th Semester/Social Innovation/gh/"
os.chdir(directory)
# Now you can access variables and functions from your_script_name
c = prueba.sfg('Wildest Dreams')  # Example: calling a function from your external script
c = list(c[0])
# ---------- end py3_2 ----------
item = ListItem(List=py3_2.c, Index=py3.a, Wrap=True)
panel = Panel(item)
py3_3 = Python3Script(x=panel)  # -> out, R, G, B
# ---------- py3_3: Python ----------
def colors(l):
    numbers = l.split()
    r = numbers[0]
    r = int(r)
    g = numbers[1]
    g = int(g)
    b = numbers[2]
    b = int(b)
    
    return r, g, b


R, G, B = colors(x[1:-1])  # Exclude brackets
print(R, G, B)
# ---------- end py3_3 ----------
rgb = ColourRGB(Alpha=255, Red=py3_3.R, Green=py3_3.G, Blue=py3_3.B)
mcol_3 = MeshColours(Mesh=mesh_3, Colours=rgb)

mesh_4 = Mesh(<mesh referenced from the Rhino model>)  # disabled
wheel_2 = ColourWheel(
    Slider(0, range=0..10),
    ColourGrips_Style=31,
    ColourGrips_Grip=[4.817586491, 0.6287962864, 2.723191389, 1.675993838],
    ColourGrips_Lum=[0.4292022982, 0.1858593574],
    ColourGrips_Range=[2.586695162, 2.586695162, 2.586695162, 2.586695162],
    ColourGrips_Sat=[0.4866029746, 0.6967433237])

explode = MeshExplode(Mesh=mesh_4, Interpolate=False)

mcol_4 = MeshColours(Mesh=explode, Colours=wheel_2)
